# Grasshopper definition 200404_RotatingRectangle_MalletStevens.gh (Grasshopper 1.0.7)
# plug-ins: Bifocals

number_slider = Slider(15, range=2..20)
xz_plane = XZPlane(Origin=Point(0, 0, 0))
distanceframe = Slider(7, range=0..100)
framecount = Slider(88, range=0..100)
negative = Negative(Value=number_slider)
angleframes = Slider(7, range=0..100)
construct_domain = ConstructDomain(DomainStart=number_slider, DomainEnd=negative)
series = Series(Start=0, Step=distanceframe, Count=framecount)
unit_y = UnitY(Factor=series)
multiplication = Multiplication(A=framecount, B=distanceframe)
negative_2 = Negative(Value=multiplication)
rectangle = Rectangle(Plane=xz_plane, XSize=construct_domain, YSize=construct_domain, Radius=0)  # -> Rectangle, Length
series_2 = Series(Start=0, Step=angleframes, Count=framecount)
construct_domain_2 = ConstructDomain(DomainStart=multiplication, DomainEnd=negative_2)
move = Move(Geometry=xz_plane, Motion=unit_y)  # -> Geometry, Transform
move_2 = Move(Geometry=rectangle.Rectangle, Motion=unit_y)  # -> Geometry, Transform
rotate = Rotate(Geometry=move_2.Geometry, Angle=degrees(series_2), Plane=move.Geometry)  # -> Geometry, Transform
rectangle_2 = Rectangle(Plane=PlaneXY(0, 0, 0), XSize=construct_domain_2, YSize=construct_domain_2, Radius=0)  # -> Rectangle, Length
boundary_surfaces = BoundarySurfaces(Edges=rectangle_2.Rectangle)
surface_curve = SurfaceCurve(Surface=boundary_surfaces, Curve=rotate.Geometry)  # -> Curves, Points, UVPoints, Normals, Parameters, Tangents
multiplication_2 = Multiplication(A=number_slider, B="2")
shatter = Shatter(Curve=graft(rotate.Geometry), Parameters=surface_curve.Parameters)
unit_z = UnitZ(Factor="0.1")
box_rectangle = BoxRectangle(Rectangle=rectangle_2.Rectangle, Height=multiplication_2)
shape_in_brep = ShapeInBrep()
move_3 = Move(Geometry=box_rectangle, Motion=unit_z)  # -> Geometry, Transform
shape_in_brep_2 = ShapeInBrep(Brep=move_3.Geometry, Shape=shatter)
panel = Panel(shape_in_brep_2)
subtraction = Subtraction(A=shape_in_brep_2, B="1")
dispatch = Dispatch(List=shatter, DispatchPattern=subtraction)  # -> ListA, ListB
geometry = Geometry(dispatch.ListB)
